% Requirement links of WareHouseTaskRobotArchitecture.slx (R2024b)

block :148 implements RobotHazardAssessment.mldatx: RobotHazardAssessment.mldatx | cell: 4, Function
block :148 implements RobotHazardAssessment.mldatx: RobotHazardAssessment.mldatx | cell: 5, Function
block :148 implements RobotHazardAssessment.mldatx: RobotHazardAssessment.mldatx | cell: 6, Function
block :38 implements RobotHazardAssessment.mldatx: RobotHazardAssessment.mldatx | cell: 1, Function
block :38 implements RobotHazardAssessment.mldatx: RobotHazardAssessment.mldatx | cell: 2, Function
block :38 implements RobotHazardAssessment.mldatx: RobotHazardAssessment.mldatx | cell: 3, Function
block :48 implements assets.mldatx: assets.mldatx | cell: 1, ModelElement