% Requirement links of FMEA.mldatx (R2024b)

item 1 relates to WareHouseTaskRobotSimulationModel.slx: WareHouseTaskRobotSimulationModel Conditional: EmergencyBrakeActive
item 2 relates to WareHouseTaskRobotSimulationModel.slx: stuck_steering in WareHouseTaskRobotSimulationModel/Plant/Kinematic Model/Bus Element In2/Outport/1
item 3 relates to WareHouseTaskRobotSimulationModel.slx: WareHouseTaskRobotSimulationModel Conditional: EmergencyBrakeActive
item 4 relates to RobotHazardAssessment.mldatx: RobotHazardAssessment.mldatx | row: 7
item 5 relates to WareHouseTaskRobotSimulationModel.slx: position_fault in WareHouseTaskRobotSimulationModel/Robot Architecture/Position Sensor/Outport/1
item 6 relates to RobotHazardAssessment.mldatx: RobotHazardAssessment.mldatx | row: 4
item 6 relates to RobotHazardAssessment.mldatx: RobotHazardAssessment.mldatx | row: 5